# Grasshopper definition SynapseExample.gh (Grasshopper 1.0.7)
# plug-ins: Synapse

genes = GenePool(Decimals=0, Maximum=99, Minimum=1, Value=[35.98291824, 41, 36, 72])
genes_2 = GenePool(Decimals=0, Maximum=99, Minimum=1, Value=[75, 40, 74, 74])
color0 = Slider(0.24, range=0.01..1)
color1 = Slider(0.41, range=0.01..1)
color2 = Slider(0.83, range=0.01..1)
color3 = Slider(1, range=0.01..1)
genes_3 = GenePool(Decimals=0, Maximum=99, Minimum=1, Value=[19, 19, 21, 31])
genes_4 = GenePool(Decimals=0, Maximum=99, Minimum=1, Value=[31, 16, 32, 20])
gradient = Gradient(
    LowerLimit="0",
    UpperLimit="1",
    Parameter=[color0, color1, color2, color3],
    stops=[0: RGB(234, 38, 0), 0.25: RGB(234, 126, 0), 0.5: RGB(254, 244, 84), 0.75: RGB(173, 203, 249), 1: RGB(75, 107, 169)])
merge = Merge(Data1=graft(genes_3), Data2=graft(genes), Data3=graft(genes_2), Data4=graft(genes_4))
panel = Panel("""DecimalPlaces
Increment""")
argb = SplitARGB(Colour=ColourSwatch(SwatchColor=RGB(50, 132, 209)), IntegerChannels=True)  # -> Alpha, Red, Green, Blue
panel_2 = Panel("""sliderwidth
maxvalue
minvalue
steps""")
item = ListItem(List=gradient, Index=0, Wrap=True)  # -> Item, Item1, Item2, Item3
flip = FlipMatrix(Data=merge)  # -> simplify(Data)
scolor = SynapseColor(Alpha=argb.Alpha, Red=argb.Red, Green=argb.Green, Blue=argb.Blue)

# ---- group: stack properties
number_slider = Slider(260, range=100..800)
D = Slider(10, range=5..20)
D_2 = Slider(5, range=5..20)
size = SynapseSize(Width=number_slider, Height=Slider(200, range=100..800))
int = Integer(D_2)
int_2 = Integer(D)

# ----
sdm = SynapseDropMenu(Options=flatten(["Alpha", "Beta", "Omega"]))  # -> AllProperties, Control
series = Series(Start=0, Step=1, Count="4")
sfont = SynapseFont(FontFamily="Lucida Console", FontSize=8.25, FontStyle=0, Decoration=0)
panel_3 = Panel("""2
2""")
merge_2 = Merge(
    Data1=Slider(23, range=1..99),
    Data2=Slider(40, range=1..99),
    Data3=Slider(12, range=1..99),
    Data4=Slider(60, range=1..99))
merge_3 = Merge(Data1=item.Item, Data2=item.Item1, Data3=item.Item2, Data4=item.Item3)
complex = CreateComplex(Real=Slider(117, range=50..200), Imaginary=Slider(99, range=50..200))
panel_4 = Panel("""115
0.8
0.2
5""")
scombo = SynapseComboBox(Options=flatten(["Alpha", "Beta", "Omega"]))  # -> AllProperties, Control
stb = SynapseTextBox(Mask="(000) 000 0000")  # -> AllProperties, Control, AllMasks
int_3 = Integer(panel_3)
panel_5 = Panel("""Some option A
A better option B
Another option C
Last option D""")
ss = SynapseSlider(Property=flatten(panel_2), PropertyValue=flatten(panel_4), Coefficient=0.01)  # -> AllProperties, Control
slbl = SynapseLabel(Property=flatten("text"), PropertyValue=flatten("object name"))  # -> AllProperties, Control
stb_2 = SynapseTextBox(Property=flatten("TextColor"), PropertyValue=flatten(scolor))  # -> AllProperties, Control
sbtn = SynapseButton(Property=flatten("Font"), PropertyValue=flatten(sfont))  # -> AllProperties, Control
snud = SynapseNumUpDn(Property=flatten(panel), PropertyValue=flatten(int_3))  # -> AllProperties, Control
scb = SynapseCheckBox(Property=flatten("TextColor"), PropertyValue=flatten(ColourSwatch(SwatchColor=RGB(178, 43, 154))))  # -> AllProperties, Control
panel_6 = Panel("""Size
Spacing""")
int_4 = Integer("200")
X = Slider(26, range=1..50, expression="x*10")
smt = SynapseMultiTexts(Property=flatten("Width"), PropertyValue=flatten(int_4))  # -> AllProperties, Control
pickone = SynapseSingleSelect(Options=flatten(panel_5))  # -> AllProperties, Control
slb = SynapseListBox(Options=flatten(["Alpha", "Beta", "Omega"]))  # -> AllProperties, Control
sstack = SynapseStack(
    Property=flatten(panel_6),
    PropertyValue=flatten([size, int]),
    Controls=flatten([scombo.Control, sdm.Control, stb.Control]))  # -> AllProperties, Control
D_3 = Slider(14, range=5..20)
strends = SynapseTrends(Size=complex, Numbers=flip, Name=graft(series), Color=graft(merge_3))  # -> ChartObject, ChartData
shrrchy = SynapseHierarchy(Size=complex, Numbers=merge_2, Colors=merge_3)  # -> ChartObject, ChartData
sxpdr = SynapseExpander(Property=flatten("Expanded"), PropertyValue=flatten(Toggle(True)), Controls=flatten(pickone.Control))  # -> AllProperties, Control
panel_7 = Panel("""Orientation
Size
Spacing""")
merge_4 = Merge(Data1=flatten("horizontal"), Data2=flatten(size), Data3=flatten(int))
panel_8 = Panel("""Size
Padding
Spacing""")
int_5 = Integer(X)
# some properties won't convert data type automatically;
# manually enforce the integer type
int_6 = Integer(D_3)
legend = SynapsePieLegend(Property=flatten("Marker"), PropertyValue=flatten("bullet"), PieData=strends.ChartData)  # -> AllProperties, Legend
legend_2 = SynapsePieLegend(Property=flatten("Marker"), PropertyValue=flatten("bullet"), PieData=shrrchy.ChartData)  # -> AllProperties, Legend
merge_5 = Merge(
    Data1=flatten(scb.Control),
    Data2=flatten(sbtn.Control),
    Data3=flatten(slbl.Control),
    Data4=flatten(snud.Control),
    Data5=flatten(ss.Control),
    Data6=flatten(stb_2.Control))
merge_6 = Merge(Data1=flatten(int_6), Data2=flatten(int_6), Data3=flatten(int_5))
sstack_2 = SynapseStack(Property=flatten(panel_7), PropertyValue=flatten(merge_4), Controls=flatten([slb.Control, sstack.Control]))  # -> AllProperties, Control
toggle = BooleanToggle(True)
panel_9 = Panel("""Padding
Width""")
panel_10 = Panel("""padding
spacing
Width""")
txy = SynapseTableXY(Controls=merge_5, Columns=2)  # -> Coordinates, Dimensions
panel_11 = Panel("flow")
chart_legend = Data([shrrchy.ChartObject, legend_2.Legend])
chart_legen = Data([strends.ChartObject, legend.Legend])
int_7 = Integer(["10", number_slider])
sstack_3 = SynapseStack(Property=flatten(panel_8), PropertyValue=flatten([size, int_2, int]), Controls=flatten([smt.Control, sxpdr.Control]))  # -> AllProperties, Control
sstack_4 = SynapseStack(Property=flatten(panel_8), PropertyValue=flatten([size, int_2, int]), Controls=flatten(sstack_2.Control))  # -> AllProperties, Control
table = SynapseTable(
    Property=flatten(panel_10),
    PropertyValue=flatten(merge_6),
    Controls=flatten(merge_5),
    ControlLocation=flatten(txy.Coordinates),
    TableDimension=txy.Dimensions)  # -> AllProperties, Control
sdlo = SynapseDynamicLayout(Property=flatten(panel_9), PropertyValue=flatten(int_7), Controls=flatten(chart_legend))  # -> AllProperties, Control
sampler = SynapseSampler(Size=Slider(150, range=0..1000), Color=RGB(45, 45, 45), LineStroke=3)  # -> AllProperties, Control
Y = Slider(29, range=1..50, expression="x*10")
X_2 = Slider(30, range=1..50, expression="x*10")
sdylo = SynapseDynamicLayout(Controls=flatten(sampler.Control))  # -> AllProperties, Control
padding = Slider(5, range=1..15)
vec = VectorXYZ(XComponent=X_2, YComponent=Y, ZComponent=0)  # -> Vector, Length
merge_7 = Merge(
    Data1=flatten(table.Control),
    Data2=flatten(sstack_3.Control),
    Data3=flatten(sstack_4.Control),
    Data4=flatten(sdlo.Control))
list = ValueList({"1st": 0, "2nd": 1, "3rd": 2, "4th": 3}, selected="4th")
resizable = BooleanToggle(False)
topmost = BooleanToggle(True)
pypt = GhPythonScript(x=Slider(1, range=1..50, expression="x*10"), y=Slider(4, range=1..50, expression="x*10"))  # -> out, p; inputs x: Int32, y: Int32
# ---------- pypt: Python ----------
"""creating an Eto.Drawing.Point object for Synapse plugin to consume.
    Inputs:
        x: x coordinate
        y: y coordinate
    Output:
        p: point object"""

__author__ = "wwang"
__version__ = "2021.02.19"

import Eto.Drawing as drw

p = drw.Point(x,y)
# ---------- end pypt ----------
panel_12 = Panel("""Apple
Banana
Cantaloupe
Dragonfruit""")
int_8 = Integer(padding)
int_9 = Integer(list)
merge_8 = Merge(
    Data1=flatten(scolor),
    Data2=flatten("NimbleDashboard"),
    Data3=flatten(pypt.p),
    Data4=flatten(vec.Vector),
    Data5=flatten(topmost),
    Data6=flatten(int_8),
    Data7=flatten(resizable))
tab = SynapseTabs(Property=flatten("SelectedIndex"), PropertyValue=flatten(int_9), Controls=flatten(merge_7), TabName=flatten(panel_12))  # -> AllProperties, Control
panel_13 = Panel("""color
title
Location
size
Topmost
Padding
Resizable""")
showwindow = BooleanToggle(False)
swindow = SynapseWindow(
    Show=showwindow,
    Property=flatten(panel_13),
    PropertyValue=flatten(merge_8),
    Contents=flatten(tab.Control),
    ctrlfill=False,
    ctrlredo=True)
