# Grasshopper definition SynapseWebViewSandbox.gh (Grasshopper 1.0.7)
# plug-ins: Synapse

ssize = SnpSize(Width=Slider(5, range=2..10, expression="x*100"), Height=Slider(3, range=2..10, expression="x*100"))
py_wv = GhPythonScript(x=Toggle(False), S=ssize)  # -> a; disabled
# ---------- py_wv: Python ----------
__author__ = "Will Wang"
__version__ = "2022.01.31"

from ghpythonlib.componentbase import executingcomponent as component
import Grasshopper, GhPython
import System
import Rhino
import Eto.Forms as eforms
import Eto.Drawing as edrw
import Rhino.RhinoApp as rhapp

class WVSandbox(component):
    def __init__(self):
        super(WVSandbox, self).__init__()
        self.win = None
        self.txtout = ''
        self.btnpress = False
    
    def RunScript(self, x, S):
        if x:
            if not self.win:
                self.NewWin(S)
            elif not self.win.Visible:
                self.win.Show()
        else:
            self.NewWin(S)

        return self.txtout

    def NewWin(self, size):
        self.win = eforms.Form()
        self.wv = eforms.WebView()
        self.wv.Size = size
        self.layout = eforms.DynamicLayout()
        self.layout.AddSeparateRow(self.wv, None)
        self.layout.AddSeparateRow(None)
        self.win.Content =self.layout
        
        with open(r'D:\Github repos\GH_Eto\SynapseWebView.html', 'r') as html:
            self.wv.LoadHtml(html.read())
        
        self.wv.DocumentLoading += self.OnRefresh

    def OnRefresh(self, s, e):
        try:
            if e.Uri.Scheme == 'synapse':
                if e.Uri.LocalPath == 'num_param':
                    self.txtout = str(self.wv.ExecuteScript(
                        """
                        var e = document.getElementById('num_param');
                        try{ return e.value;}
                        catch (er) {return 'ERROR getting element by id';}
                        """
                        )
                    )
                elif e.Uri.LocalPath == 'tf_param':
                    self.txtout = str(self.wv.ExecuteScript(
                        'return document.getElementById("tf_param").checked;'
                        )
                    )
                elif e.Uri.LocalPath == 'btn_param':
                    if e.Uri.Query == '?press':
                        self.btnpress = True
                    elif e.Uri.Query =='?lift':
                        self.btnpress = False
                    self.txtout = str(self.btnpress)
                e.Cancel = True
                self.ExpireSolution(True) # expire in event handler is ok!
        except Exception as ex:
            eforms.MessageBox.Show(str(ex))
# ---------- end py_wv ----------
panel = Panel("""num_param
btn_param
tf_param""")
file = ReadFile(File="D:\Github repos\GH_Eto\SynapseWebView.html", PerLineParse=False)
panel_2 = Panel(py_wv)
sdomsl = SnpDomSlider()  # -> AllProperties, Control
sdylo = SnpDynaLayout(Controls=flatten(sdomsl.Control))  # -> AllProperties, Control
svalq = SnpValueQuery(SynapseObject=sdomsl.Control, Update=True)
panel_3 = Panel(svalq)
swin = SnpWindow(Show=Toggle(False), Contents=flatten(sdylo.Control), ctrlfill=False, ctrlredo=False, ghowned=False)  # -> AllProperties, Window
